# Grasshopper definition Vector Display (python).gh (Grasshopper 1.0.7)

vec = Vector(Vector(4029255.89, 1151536.595, 0))
pt = Point([Point(-870228.0274, -436316.5473, 0), Point(-1932909.303, -1457380.497, 0), Point(-1360056.221, -2012348.495, 0), Point(672232.888, -1429529.118, 0), Point(1535688.223, -54696.33377, 0)])
python = GhPythonScript(pt=pt, vec=vec, color=ColourSwatch(SwatchColor=RGB(0, 255, 157)))  # inputs pt: Point3d, vec: Vector3d, color: Color
# ---------- python: Python ----------
from ghpythonlib.componentbase import executingcomponent as component
import System.Drawing as sd
import Rhino.Geometry as rg

class MyComponent(component):
    lines = []
    colors = []
    
    def RunScript(self, pt, vec, color):
        if not pt :return 
        if not vec :return
        self.lines.append(rg.Line(pt,pt+vec))
        if not color:
            self.colors.append(sd.Color.Red)
        else:
            self.colors.append(color)
    def DrawViewportWires(self,args):
        count = len(self.lines)
        for i in xrange(count):
            args.Display.DrawArrow(self.lines[i],self.colors[i])
    
    
    def GetBoundingBox(self):
        if len(self.lines) == None:
            return rg.BoundingBox.Empty
        else:
            self.box = rg.BoundingBox.Unset
            for line in self.lines:
                self.box.Union(line.BoundingBox)
            return self.box
    
    def get_ClippingBox(self):
        return self.GetBoundingBox()
    
    def BeforeSolveInstance(self):
        self.lines = []
        self.colors = []
# ---------- end python ----------
